# Grasshopper definition differential-line-growth.gh (Grasshopper 1.0.7)
# plug-ins: Kangaroo2 Components

curve = Curve(<curve referenced from the Rhino model>)
curve_2 = Curve(<curve referenced from the Rhino model>)
divide = DivideCurve(Curve=curve_2, Count=950, Kinks=False)  # -> Points, Tangents, Parameters
mesh = Mesh(curve)
pline = PolyLine(Vertices=divide.Points, Closed=False)

# ---- group: Try to Increase this value slowly from the start of 1
number_slider = Slider(6.336, range=1..50)

# ----
explode = Explode(Curve=pline, Recursive=True)  # -> Segments, Vertices
len = Length(Curve=explode.Segments)
item = ListItem(List=len, Index=0, Wrap=True)
multiplication = Multiplication(A=number_slider, B=item)
multiplication_2 = Multiplication(A=Slider(1, range=0..1), B=multiplication)
length_line = LengthLine(Line=explode.Segments, Length=multiplication, Strength=1)
onmesh = OnMesh(Points=divide.Points, Mesh=mesh, Strength=100)
sc = SphereCollide(Points=divide.Points, Radius=multiplication_2, Strength=10)

on = BooleanToggle(True)
reset = Button()

solver = Solver(GoalObjects=[sc, length_line, onmesh], Reset=reset, Threshold=1e-15, Tolerance=0.01, On=on)  # -> I, V, O
pline_2 = PolyLine(Vertices=solver.V, Closed=False)
fillet = Fillet(Curve=pline_2, Radius=Slider(0.19, range=0..1))
