# Grasshopper definition side-table.gh (Grasshopper 1.0.7)

panel = Panel(" front panel")
panel_2 = Panel(" tabletop")
slot_length = Slider(1.5, range=0..5)
slot_height = Slider(2.5, range=0..5)
slot_width = Slider(0.5, range=0..1)
plywood_thickness = Slider(0.5, range=0..1)
xy_plane = XYPlane(Origin=Point(0, 0, 0))
xz_plane = XZPlane(Origin=Point(0, 0, 0))
xy_plane_2 = XYPlane(Origin=Point(0, 0, 0))
unit_z = UnitZ(Factor=plywood_thickness)
rectangle = Rectangle(Plane=xy_plane_2, XSize=slot_width, YSize=plywood_thickness, Radius=0)  # -> Rectangle, Length
panel_width = Slider(12, range=8..16)
panel_height = Slider(14, range=8..16)
rectangle_2 = Rectangle(Plane=xz_plane, XSize=panel_width, YSize=panel_height, Radius=0)  # -> Rectangle, Length
box_rectangle = BoxRectangle(Rectangle=rectangle_2.Rectangle, Height=plywood_thickness)
box_rectangle_2 = BoxRectangle(Rectangle=rectangle.Rectangle, Height=plywood_thickness)
unit_z_2 = UnitZ(Factor=panel_height)
leg_length = Slider(32, range=20..40)
tapletop_width = Slider(15, range=10..40)
tabletop_length = Slider(35, range=20..40)
rectangle_3 = Rectangle(Plane=xy_plane, XSize=tapletop_width, YSize=tabletop_length, Radius=Slider(2.5, range=0..10))  # -> Rectangle, Length
boundary_surfaces = BoundarySurfaces(Edges=rectangle_3.Rectangle)
extrude = Extrude(Base=boundary_surfaces, Direction=unit_z)
move = Move(Geometry=extrude, Motion=unit_z_2)  # -> Geometry, Transform
panel_3 = Panel(" back panel")
xz_plane_2 = XZPlane(Origin=Point(0, 0, 0))
rectangle_4 = Rectangle(Plane=xz_plane_2, XSize=panel_width, YSize=panel_height, Radius=0)  # -> Rectangle, Length
box_rectangle_3 = BoxRectangle(Rectangle=rectangle_4.Rectangle, Height=plywood_thickness)
unit_y = UnitY(Factor=leg_length)
move_2 = Move(Geometry=box_rectangle_3, Motion=unit_y)  # -> Geometry, Transform
